# Requirement set req_set (R2022a)

## 1 [#1] Входное значение
Управляющий сигнал поющего фонтана.

## 2 [#2] Выходное значение
На выходе получаем высоту струи воды из сопла фонтана.

## 3 [#3] Сила струи
Функция расчёта силы струи воды на выходе из сопла фонтана.

## 4 [#4] Системная константа
Константа содержит значение силы тяжести, рассчитанное для объекта массой 500кг.

## 5 [#5] Линия обратной связи
Линия обратной связи для сумматора.

## 6 [#6] PID регулятор

## 7 [#7] Функция вычисления мощности

## 8 [#8] Имитация подвесного ящика
Необходимо для вычисления высоты струи воды из сопла фонтана.

## 9 [#9] Генератор
Генератор входных значений

## 10 [#10] Шина данных